# Grasshopper definition SpacePartition.gh (Grasshopper 1.0.7)
# plug-ins: FloorsAndVolumes, Human, PTComponentLibrary, SpaceSyntaxDesign_GH

# ---- group: ID
text = Text(Tree({0;0}: ["5"], {0;1}: ["5"], {0;2}: ["5"], {0;3}: ["5"], {0;4}: ["5"], {0;5}: ["5"]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))

# ---- group: Labels
text_2 = Text(Tree({0;0}: ["Unidades sanitarias mujeres / privadas"], {0;1}: ["Unidades sanitarias hombres / privadas"], {0;2}: ["Cuarto de aseo "], {0;3}: ["Área de aseo de residuos"], {0;4}: ["Almacen General Insumos de Aseo "], {0;5}: ["Área de UPC-Rack"]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))

# ---- group: Areas
text_3 = Text(Tree({0;0}: ["3"], {0;1}: ["3"], {0;2}: ["6"], {0;3}: ["1"], {0;4}: ["5"], {0;5}: ["4"]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))

# ---- group: Topology
integer = Integer(Tree({0}: [7], {1}: [7], {2}: [3], {3}: [2, 11], {4}: [16, 21, 19], {5}: [19]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))

# ----
path_mapper = PathMapper(integer, source="{A;B}", target="{A}")
path_mapper_2 = PathMapper(text, source="{A;B}", target="{A}")
path_mapper_3 = PathMapper(text_3, source="{A;B}", target="{A}")
prunelastbranch = CSharpScript(branches=path_mapper_3)  # -> prunedTree, branchCounter; inputs branches: tree of String
# ---------- prunelastbranch: C# ----------
    var treeOut = new DataTree<string>();

    for( int i = 0; i < branches.BranchCount - 1; ++i )
      treeOut.AddRange(branches.Branch(i), new GH_Path(i));

    prunedTree = treeOut;
    branchCounter = treeOut.BranchCount;
# ---------- end prunelastbranch ----------

# ---- group: Grid / Controllers
number_slider = Slider(21, range=0..21)
number_slider_2 = Slider(5, range=0..5)
division = Division(A=number_slider, B=Slider(8, range=0..10))
division_2 = Division(A=number_slider_2, B=Slider(1.5, range=0..10))
number_slider_3 = Slider(0, range=0..1)  # disabled

# ----
mass_addition = MassAddition(Input=prunelastbranch.prunedTree)  # -> Result, PartialResults
panel = Panel(prunelastbranch.prunedTree)

# ---- group: Voronoi / Controllers
number_slider_4 = Slider(4, range=0..25)
seedsy = GenePool(Decimals=2, Maximum=1, Minimum=0, Value=[0.8806590754, 0.607026242, 0.3693540238, 0.6950869279])
seedsx = GenePool(Decimals=2, Maximum=1, Minimum=0, Value=[0.3580219952, 0.5197490382, 0.1938906844, 0.7780237821])

# ----
panel_2 = Panel(mass_addition.Result)
number = Number(mass_addition.Result)
number_slider_5 = Slider(0, range=0..50)
curve = Curve(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)
multiplication = Multiplication(A=number, B=Slider(0.2, range=0..1))
multiplication_2 = Multiplication(A=number, B=0.3)
addition = Addition(A=number, B=multiplication_2)  # -> simplify(Result)
addition_2 = Addition(A=addition, B=multiplication)  # -> simplify(Result)
panel_3 = Panel(addition_2)
subtraction = Subtraction(A=addition, B=multiplication)  # -> simplify(Result)
mass_addition_2 = MassAddition(Input=flatten(addition))  # -> Result, PartialResults
curve_2 = Curve([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])
panel_4 = Panel("""0: Privado
1: Privado
2: Público
3: SemiPrivado""")
graft_tree = GraftTree(Tree=panel_4, IncludeEmptyLists=True, IncludeNullItems=True)
galapagos = Galapagos(fitness=mass_addition_3, gene=[seedsx, seedsy])
panel_5 = Panel(addition)

# ---- group: Grid
number_slider_6 = Slider(22, range=0..100)  # disabled
number_slider_7 = Slider(4, range=0..10)  # disabled
number_slider_8 = Slider(0, range=0..100)  # disabled
construct_domain = ConstructDomain(DomainStart=number_slider_8, DomainEnd=number_slider_7)  # disabled
number_slider_9 = Slider(2, range=0..10)  # disabled
genepoolmodifier = GenePoolModifier(GeneList="Weights", Count=expr("x+1", number_slider_6), Domain=construct_domain)  # disabled
number_slider_10 = Slider(17.8173, range=-50..20)  # disabled
knot_vector = KnotVector(Count=expr("x+1", number_slider_6), Degree=number_slider_9, Periodic=False)  # disabled
dom = ConstructDomain(DomainStart=expr("-x", number_slider), DomainEnd=number_slider)
range = Range(Domain=dom, Steps=number_slider_6)  # disabled
dom_2 = ConstructDomain(DomainStart=expr("-x", number_slider_2), DomainEnd=number_slider_2)
weights = GenePool(Decimals=2, Maximum=4, Minimum=0, Value=[2, 2, 2, 2, 2, 2, 2, 2, 2, 2, 2, 2, 2, 2, 2, 2, 2, 2, 2, 2, 2, 2, 2])  # disabled
unit_x = UnitX(Factor=number_slider_10)  # disabled
point = Point(Point(-27.55069635, 0.2364199029, 0))
number_slider_11 = Slider(1000, range=0..1000)  # disabled
number_slider_12 = Slider(0, range=0..1000)  # disabled
number_slider_13 = Slider(0, range=0..1000)  # disabled
deconstruct_domain = DeconstructDomain(Domain=dom)  # -> Start, End
rectangle = Rectangle(Plane=point, XSize=dom_2, YSize=dom, Radius=0)  # -> Rectangle, Length
unit_y = UnitY(Factor=deconstruct_domain.Start)
colour_rgb = ColourRGB(Alpha=255, Red=number_slider_11, Green=number_slider_12, Blue=number_slider_13)  # disabled
number_slider_14 = Slider(3.01, range=0..10)  # disabled
move = Move(Geometry=point, Motion=unit_y)  # -> Geometry, Transform
crv = Curve(rectangle.Rectangle)
ptsrfdomlen = SurfaceDomainLength(Surface=crv, ULength=division_2, VLength=division)
ptborders = GenerateBorders(Grid=ptsrfdomlen, PanelShape=0)  # -> simplify(Border)
crv_2 = Curve(flatten(ptborders))

# ---- group: Grid / Perlin
number_slider_15 = Slider(4, range=0..10)  # disabled
number_slider_16 = Slider(2.2, range=0..10)  # disabled
number_slider_17 = Slider(0.575734, range=0..1)  # disabled
number_slider_18 = Slider(13.910642, range=0..100)  # disabled
number_slider_19 = Slider(27.513073, range=0..100)  # disabled
number_slider_20 = Slider(1000, range=0..1000)  # disabled
perlinnoise = CSharpScript(x=range, fre=number_slider_16, amp=number_slider_17, iter=number_slider_15, t=number_slider_19, seed=number_slider_20)  # -> out, A; inputs x: Double, fre: Double, amp: Double, iter: Int32, t: Double, seed: Int32; disabled
# ---------- perlinnoise: C# ----------
    //time+=1e-7;
    
    A = fbm(new vec3(x, 0, 0) + t, fre, amp, iter, seed);
# ---------- perlinnoise: C# additional code ----------
  //double time = 0;
  
  double hash(double a, int seed)
  {

    //return fract(Math.Sin(a) * 4513.15);
    var rand = new Random( seed );
    return rand.NextDouble() * ( 1.0 + 1.0 ) - 1.0;

  }

  double noise(vec3 x, int seed)
  {

    vec3 p = x.floor();
    vec3 k = x.fract();

    k *= k * k * ( 3.0 - 2.0 * k );

    double n = p.X() + p.Y() * 57.0 + p.Z() * 113.0;

    double a = hash(n, seed);
    double b = hash(n + 1.0, seed);
    double c = hash(n + 57.0, seed);
    double d = hash(n + 58.0, seed);

    double e = hash(n + 113.0, seed);
    double f = hash(n + 114.0, seed);
    double g = hash(n + 170.0, seed);
    double h = hash(n + 171.0, seed);

    double res = vec3.mix(vec3.mix(vec3.mix(a, b, k.X()), vec3.mix(c, d, k.X()), k.Y()),
      vec3.mix(vec3.mix(e, f, k.X()), vec3.mix(g, h, k.X()), k.Y()),
      k.Z()
      );

    return res;

  }

  double fbm(vec3 f, double freq, double ampl, int iter, int seed)
  {

    double amp = 1.0, fre = 1.7, res = 0.0;

    for( int i = 0; i < iter; ++i )
    {

      amp *= ampl;
      fre *= freq;

      amp += amp;

      res += amp * noise(fre * f, seed);

    }

    return res;

  }

  class vec3
  {

    double x, y, z;

    public vec3(double x, double y, double z)
    {

      this.x = x;
      this.y = y;
      this.z = z;

    }

    public vec3(Point3d point)
    {

      this.x = point.X;
      this.y = point.Y;
      this.z = point.Z;

    }

    public double X()
    {

      return x;

    }

    public double Y()
    {

      return y;

    }

    public double Z()
    {

      return z;

    }

    // Addition operator overload.
    public static vec3 operator+( vec3 x, vec3 y )
    {

      return new vec3(x.X() + y.X(), x.Y() + y.Y(), x.Z() + y.Z());

    }

    public static vec3 operator+( vec3 x, double y )
    {

      return new vec3(x.X() + y, x.Y() + y, x.Z() + y);

    }

    public static vec3 operator+( double y, vec3 x )
    {

      return new vec3(y + x.X(), y + x.Y(), y + x.Z());

    }

    // Subtraction operator overload.
    public static vec3 operator-( vec3 x, vec3 y )
    {

      return new vec3(x.X() - y.X(), x.Y() - y.Y(), x.Z() - y.Z());

    }

    public static vec3 operator-( vec3 x, double y )
    {

      return new vec3(x.X() - y, x.Y() - y, x.Z() - y);

    }

    public static vec3 operator-( double y, vec3 x )
    {

      return new vec3(y - x.X(), y - x.Y(), y - x.Z());

    }

    // Multiplication operator overload.
    public static vec3 operator*( vec3 x, vec3 y )
    {

      return new vec3(x.X() * y.X(), x.Y() * y.Y(), x.Z() * y.Z());

    }

    public static vec3 operator*( vec3 x, double y )
    {

      return new vec3(x.X() * y, x.Y() * y, x.Z() * y);

    }

    public static vec3 operator*( double y, vec3 x )
    {

      return new vec3(y * x.X(), y * x.Y(), y * x.Z());

    }

    // Fractional part of a vec3.
    public vec3 fract()
    {

      return new vec3(fract(x), fract(y), fract(y));

    }

    // Floor.
    public vec3 floor()
    {

      return new vec3(Math.Floor(x), Math.Floor(y), Math.Floor(z));

    }

    // Fractional part of a double.
    public double fract(double x)
    {

      return x - Math.Truncate(x);

    }

    // Linear interpolation of a double.
    public static double mix(double a, double b, double c)
    {

      return a - ( 1 - c ) + b * c;

    }

    // Linear interpolation of a vec3.
    public static vec3 mix(vec3 a, vec3 b, double c)
    {

      double mixX = mix(a.X(), b.X(), c);
      double mixY = mix(a.Y(), b.Y(), c);
      double mixZ = mix(a.Z(), b.Y(), c);

      return new vec3(mixX, mixY, mixZ);

    }

    public Point3d toPoint()
    {

      return new Point3d(this.X(), this.Y(), this.Z());

    }

  }

  public double fract(double x)
  {

    return x - Math.Truncate(x);

  }
# ---------- end perlinnoise ----------

# ---- group: Grid (continued)
construct_point = ConstructPoint(XCoordinate=perlinnoise.A, YCoordinate=range, ZCoordinate=0)  # disabled
list_item = ListItem(List=construct_point, Index=0, Wrap=True)  # disabled
vector_2pt = Vector2Pt(PointA=list_item, PointB=move.Geometry, Unitize=False)  # -> Vector, Length; disabled
move_2 = Move(Geometry=construct_point, Motion=vector_2pt.Vector)  # -> Geometry, Transform; disabled
nurbs_curve_pwk = NurbsCurvePWK(Points=move_2.Geometry, Weights=weights, Knots=knot_vector)  # -> Curve, Length, Domain; disabled
custom_preview_lineweights = CustomPreviewLineweights(Geometry=nurbs_curve_pwk.Curve, Shader=colour_rgb, Thickness=number_slider_14, Absolute=False)  # disabled
curve_attraction = CurveAttraction(Grid=ptsrfdomlen, CrvAtts=nurbs_curve_pwk.Curve, Magnitude=number_slider_3)  # -> Grid, Weights; disabled

# ---- group: Voronoi
dom_3 = ConstructDomain(DomainStart=expr("-x", 0), DomainEnd=1)
genemodifier = GenePoolModifier(GeneList="SeedsX", Count=number_slider_4, Domain=dom_3)
genemodifier_2 = GenePoolModifier(GeneList="SeedsY", Count=number_slider_4, Domain=dom_3)
pt = ConstructPoint(XCoordinate=seedsx, YCoordinate=seedsy, ZCoordinate=0)
evalsrf = EvaluateSurface(Surface=reparameterize(crv), Point=pt)  # -> Point, Normal, UDirection, VDirection, Frame
pt_2 = Point(evalsrf.Point)
voronoi = Voronoi(Points=pt_2, Boundary=rectangle.Rectangle, BruteForceOverride=False)

# ---- group: ManhattanVoronoi
number_slider_21 = Slider(10, range=0..10)  # disabled
ghpython_script = GhPythonScript(r=number_slider_21, P=pt_2)  # -> out, PL; inputs P: list of Point3d; disabled
# ---------- ghpython_script: Python ----------
__author__ = "Paula"
__version__ = "2019.04.23"

import rhinoscriptsyntax as rs
from Rhino.Geometry import Point3d as P3
from Rhino.Geometry import Polyline as PLine

def taxicab_midnormal ( Point_1 = P3(0,0,0), Point_2 = P3(0,0,0) , leng = 10000):
    dx = abs(Point_1.X - Point_2.X)
    dy = abs(Point_1.Y - Point_2.Y)
    
    C = P3 ( ( Point_1.X + Point_2.X ) / 2, ( Point_1.Y + Point_2.Y ) / 2, ( Point_1.Z + Point_2.Z ) / 2)
    
    """ MPQN, in which M is on the lengeft(X-) or bottom(Y-) """
    P = P3 (0,0,C.Z)
    Q = P3 (0,0,C.Z)
    M = P3 (0,0,C.Z)
    N = P3 (0,0,C.Z)
    
    if dx > dy:
        P.Y = C.Y + dy / 2
        Q.Y = C.Y - dy / 2
        M.Y = P.Y + leng
        N.Y = Q.Y - leng
        if bool(Point_1.Y > Point_2.Y) ^ bool(Point_1.X > Point_2.X):
            P.X = C.X + dy / 2
            Q.X = C.X - dy / 2
        else:
            P.X = C.X - dy / 2
            Q.X = C.X + dy / 2
        M.X = P.X
        N.X = Q.X
    else:
        if dx < dy:
            P.X = C.X + dx / 2
            Q.X = C.X - dx / 2
            M.X = P.X + leng
            N.X = Q.X - leng
            if bool(Point_1.Y > Point_2.Y) ^ bool(Point_1.X > Point_2.X):
                P.Y = C.Y + dx / 2
                Q.Y = C.Y - dx / 2
            else:
                P.Y = C.Y - dx / 2
                Q.Y = C.Y + dx / 2
            M.Y = P.Y
            N.Y = Q.Y
        else:
            if bool(Point_1.Y > Point_2.Y) ^ bool(Point_1.X > Point_2.X):
                P.Y = C.Y - dx / 2
                Q.Y = C.Y + dx / 2
                P.X = C.X - dy / 2
                Q.X = C.X + dy / 2
                M.Y = P.Y - leng
                M.X = P.X - leng
                N.Y = Q.Y + leng
                N.X = Q.X + leng
            else:
                P.Y = C.Y - dx / 2
                Q.Y = C.Y + dx / 2
                P.X = C.X + dy / 2
                Q.X = C.X - dy / 2
                M.Y = P.Y - leng
                M.X = P.X + leng
                N.Y = Q.Y + leng
                N.X = Q.X - leng

    return rs.AddPolyline( [M , P , Q , N] )

def taxicab_circle ( point = P3(0,0,0), r = 1 ):
    A = P3( point.X + r, point.Y, point.Z )
    B = P3( point.X, point.Y + r, point.Z )
    C = P3( point.X - r, point.Y, point.Z )
    D = P3( point.X, point.Y - r, point.Z )
    return rs.AddPolyline( [A, B, C, D, A] )

l = 2 * r

""" PL = taxicab_midnormal ( A, B, r ) """

pts = P

polylines = []
for i in range( len( P ) ):
    polylines.append(taxicab_circle( P[i], l ))

for i in range(len(polylines)):
    for j in range(i):
        if i == j:
            continue
        if rs.CurveBooleanUnion( [ polylines[i], polylines[j] ] ):
            MN = taxicab_midnormal( pts[i], pts[j], l )
            
            ccx = rs.CurveCurveIntersection( polylines[i], MN )
            if ccx is None:
                continue
            if ccx[0][0] == 2:
                continue
            para_a = [ ccx[0][5], ccx[1][5] ]
            para_b = [ ccx[0][7], ccx[1][7] ]
            
            if para_b[0] > para_b[1]:
                para_b = [ para_b[1], para_b[0] ]
            
            probable_dash = rs.SplitCurve(polylines[i], para_a)
            edge = rs.TrimCurve(MN, para_b, False )
            edgepts = rs.CurvePoints(edge)
            
            for crv in probable_dash:
                crvpts = rs.CurvePoints(crv)
                if rs.PointCompare( crvpts[0], edgepts[0] ):
                    crvpts.reverse()
                newpl = rs.AddPolyline( edgepts + crvpts )
                if rs.PointInPlanarClosedCurve( pts[i], newpl ):
                    polylines[i] = newpl
                    break
            
            
            ccx = rs.CurveCurveIntersection( polylines[j], MN )
            if ccx is None:
                continue
            para_a = [ ccx[0][5], ccx[1][5] ]
            para_b = [ ccx[0][7], ccx[1][7] ]
            
            if para_b[0] > para_b[1]:
                para_b = [ para_b[1], para_b[0] ]
            
            probable_dash = rs.SplitCurve(polylines[j], para_a)
            edge = rs.TrimCurve(MN, para_b, False )
            edgepts = rs.CurvePoints(edge)
            
            for crv in probable_dash:
                crvpts = rs.CurvePoints(crv)
                if rs.PointCompare( crvpts[0], edgepts[0] ):
                    crvpts.reverse()
                newpl = rs.AddPolyline( edgepts + crvpts )
                if rs.PointInPlanarClosedCurve( pts[j], newpl ):
                    polylines[j] = newpl
                    break
    

PL = polylines
# ---------- end ghpython_script ----------
region_intersection = RegionIntersection(CurvesA=ghpython_script.PL, CurvesB=rectangle.Rectangle)  # disabled
curve_3 = Curve(region_intersection)  # disabled
surface = Surface(curve_3)  # disabled

# ----
curve_4 = Curve(voronoi)
surface_2 = Surface(curve_4)
area = Area(Geometry=crv_2, UseTasks=False)  # -> Area, Centroid
sort_list = SortList(Keys=area.Area, ValuesValuesA=area.Area)  # -> Keys, ValuesValuesA
curve_5 = Curve(rectangle.Rectangle)
list_length = ListLength(List=sort_list.ValuesValuesA)
area_2 = Area(Geometry=curve_5, UseTasks=False)  # -> Area, Centroid
subtraction_2 = Subtraction(A=list_length, B=1)
list_item_2 = ListItem(List=sort_list.ValuesValuesA, Index=subtraction_2, Wrap=True)
multiplication_3 = Multiplication(A=list_item_2, B=Slider(0.5, range=0..1))
c_script = CSharpScript(voronoiIn=curve_4, gridIn=crv_2, areaIn=multiplication_3, seed=Slider(3686, range=0..10000))  # -> culledGrid, R, G, B; inputs voronoiIn: list of Polyline, gridIn: list of Polyline, areaIn: Double, seed: Int32
# ---------- c_script: C# usings ----------
using System.Linq;
# ---------- c_script: C# ----------
    var intersections = new DataTree<Curve>();
    var repeated = new DataTree<Polyline>();
    var bools = new DataTree<bool>();

    for( int i = 0; i < voronoiIn.Count; ++i )
    {

      repeated.AddRange(gridIn, new GH_Path(i));

      for( int j = 0; j < gridIn.Count; ++j )
      {

        intersections.AddRange(Curve.CreateBooleanIntersection(voronoiIn[i].ToNurbsCurve(), gridIn[j].ToNurbsCurve(), 1e-7).ToList(), new GH_Path(i, j));

      }

    }

    for( int i = 0; i < intersections.BranchCount; ++i )
    {

      var tempList = intersections.Branch(i);
      var path = new GH_Path(intersections.Path(i).Indices[0]);
      bool temp = false;

      if( tempList.Count > 0 )
      {

        temp = AreaMassProperties.Compute(intersections.Branch(i)[0]).Area < areaIn ? false : true;

        bools.Add(temp, path);

      }

      else
      {

        temp = false;
        bools.Add(temp, path);

      }

    }

    var treeOut = new DataTree<Polyline>();
    var coloursOutR = new DataTree<int>();
    var coloursOutG = new DataTree<int>();
    var coloursOutB = new DataTree<int>();
    //var coloursOut = new DataTree<System.Drawing.Color>();
    var rand = new Random(seed);

    for( int i = 0; i < bools.BranchCount; ++i )
    {

      var path = repeated.Path(i);

      coloursOutR.Add(rand.Next(0, 255), path);
      coloursOutG.Add(rand.Next(0, 255), path);
      coloursOutB.Add(rand.Next(0, 255), path);
      //coloursOut.Add( System.Drawing.Color.FromArgb( 255, rand.Next( 0, 255 ), rand.Next( 0, 255 ), rand.Next( 0, 255 ) ), path );

      for( int j = 0; j < bools.Branch(i).Count; ++j )
      {

        if( bools.Branch(i)[j] == true )
        {

          treeOut.Add(repeated.Branch(i)[j], path);

        }

      }

    }

    culledGrid = treeOut;
    R = coloursOutR;
    G = coloursOutG;
    B = coloursOutB;
    //R = coloursOut;
# ---------- end c_script ----------
panel_6 = Panel(c_script.culledGrid)
colour_rgb_2 = ColourRGB(Alpha=Slider(64, range=0..255), Red=c_script.R, Green=c_script.G, Blue=c_script.B)
region_union = RegionUnion(Curves=c_script.culledGrid)
colour_rgb_3 = ColourRGB(Alpha=Slider(255, range=0..255), Red=c_script.R, Green=c_script.G, Blue=c_script.B)
custom_preview = CustomPreview(Geometry=graft(surface_2), Material=colour_rgb_2)
region_intersection_2 = RegionIntersection(CurvesA=curve, CurvesB=region_union)  # -> simplify(Result)
surface_3 = Surface(region_intersection_2)
custom_preview_2 = CustomPreview(Geometry=surface_3, Material=colour_rgb_3)
area_3 = Area(Geometry=surface_3, UseTasks=False)  # -> simplify(Area), Centroid
flatten_tree = FlattenTree(Tree=region_intersection_2, Path="{0}")
explode_tree = ExplodeTree(Data=area_3.Centroid)  # -> Branch0, Branch1, Branch2, Branch3
polytopo = CSharpScript(curveList=flatten_tree, pointList=flatten(area_3.Centroid))  # -> relations, topoLines; inputs curveList: list of Polyline, pointList: list of Point3d
# ---------- polytopo: C# usings ----------
//using System.Linq;
# ---------- polytopo: C# ----------
    var repeat = new DataTree<Polyline>();

    var topoTree = new DataTree<int>();
    
    var lines = new DataTree<Line>();

    int count = curveList.Count;

    for( int i = 0; i < count; ++i )
    {

      var path = new GH_Path(i);

      repeat.AddRange(curveList, path);

      var temp = repeat.Branch(i)[i];
      var tempP = pointList.Branch(i)[0];

      for( int j = 0; j < repeat.Branch(i).Count; ++j )
      {

        if( j != i )

          if( Curve.PlanarCurveCollision(temp.ToNurbsCurve(), repeat.Branch(i)[j].ToNurbsCurve(), Plane.WorldXY, 1e-3) )
          {
            
            topoTree.Add(j, path);
            lines.Add( new Line( tempP, pointList.Branch(i)[1] ), path );
        
          }

      }

    }


    relations = topoTree;
    topoLines = lines;
# ---------- end polytopo ----------
null_item = NullItem(Item=area_3.Area)  # -> NullFlags, InvalidFlags, Description
cross_reference = CrossReference(ListA=polytopo.relations, ListB=polytopo.relations, CrossMode=7)  # -> ListA, ListB
line = Line(StartPoint=explode_tree.Branch0, EndPoint=explode_tree.Branch1)
line_2 = Line(StartPoint=explode_tree.Branch2, EndPoint=explode_tree.Branch3)
line_3 = Line(StartPoint=explode_tree.Branch0, EndPoint=explode_tree.Branch2)
line_4 = Line(StartPoint=explode_tree.Branch0, EndPoint=explode_tree.Branch3)
line_5 = Line(StartPoint=explode_tree.Branch1, EndPoint=explode_tree.Branch3)
integer_2 = Integer(polytopo.relations)
expression = Expression(x=null_item.NullFlags, y=area_3.Area, Expression="If( True, y, 1000 )")
expression_2 = Expression(x=expression, y=addition_2, z=subtraction, Expression="If( ( x < y) And ( x > z), 0, 1000 )")
list_item_3 = ListItem(List=flatten(area_3.Centroid), Index=integer_2, Wrap=True)
mass_addition_3 = MassAddition(Input=flatten(expression_2))  # -> Result, PartialResults
relationships = CSharpScript(points=list_item_3)  # -> lines, tester; inputs points: tree of Point3d
# ---------- relationships: C# ----------
    var linesOut = new DataTree<Line>();

    int counter = 0;
    
    var test = new List<int>();
    
    for( int i = 0; i < 4; ++i )
    {
      
      for( int j = 0; j < points.Branch(i).Count; ++j )
      {

        var county = points.Branch(i).Count;
        
        if( i < j )
        {
          
          linesOut.Add(new Line(points.Branch(i)[i], points.Branch(i)[j]), new GH_Path(i));
          
        }
        
        else if( j == 3 )
        {
          
          linesOut.Add(new Line(points.Branch(0)[0], points.Branch(0)[1]), new GH_Path(i));
          //linesOut.Add(new Line(points.Branch(i)[2], points.Branch(i)[j]), new GH_Path(i));
          
        }
        
      }
     
      counter++;
      
      test.Add( counter );
      
    }
    
    /*
    linesOut.Add( new Line( points.Branch(0)[0], points.Branch(0)[1]), new GH_Path(0) );
    linesOut.Add( new Line( points.Branch(0)[0], points.Branch(0)[2]), new GH_Path(0) );
    
    linesOut.Add(new Line(points.Branch(1)[0], points.Branch(1)[1]), new GH_Path(1));
    linesOut.Add(new Line(points.Branch(1)[1], points.Branch(1)[2]), new GH_Path(1));
    linesOut.Add(new Line(points.Branch(1)[1], points.Branch(1)[3]), new GH_Path(1));
    */
    lines = linesOut;
    
    tester = test;
# ---------- end relationships ----------
graphfromnodes_links = GraphFromNodesLinks(
    Points=flatten(area_3.Centroid),
    Links=flatten(relationships.lines),
    Labels=panel_4,
    Areas=flatten(addition),
    TotalArea=mass_addition_2.Result)  # -> Graph, GraphVertices, Attributes
panel_7 = Panel(polytopo.relations)
panel_8 = Panel(cross_reference.ListA)
panel_9 = Panel(mass_addition_3.Result)
panel_10 = Panel(list_item_3)
flatten_tree_2 = FlattenTree(Tree=surface_3, Path="{0}")  # disabled
explode_tree_2 = ExplodeTree(Data=polytopo.topoLines)  # -> Branch0, Branch1, Branch2, Branch3
text_tag = TextTag(Location=area_3.Centroid, Text=graft_tree)
explode_tree_3 = ExplodeTree(Data=graphfromnodes_links.Attributes)
forcedirecteddrawing = ForceDirectedDrawing(
    Graph=polytopo.relations,
    Vertices=flatten(area_3.Centroid),
    Attributes=graphfromnodes_links.Attributes,
    AttractionStrength=0.25,
    RepulsionStrength=1.4,
    ConvergenceTolearnce=0.001,
    MaximumIterations=500,
    Active=Toggle(True))  # -> NewGraphVertices, IterationCount
list_length_2 = ListLength(List=flatten_tree_2)  # disabled
list_length_3 = ListLength(List=crv_2)  # disabled
panel_11 = Panel(list_length_2)  # disabled
panel_12 = Panel(explode_tree_3)
line_6 = Line(explode_tree_2.Branch0)
expression_3 = Expression(x=list_length_3, y=list_length_2, Expression="If( x ≠ y, False, True )")  # disabled
panel_13 = Panel(area_3.Area)
diskographdrawing = DiskoGraphDrawing(
    Plane=PlaneXY(0, 0, 0),
    Graph=polytopo.relations,
    Vertices=forcedirecteddrawing.NewGraphVertices,
    Attributes=graphfromnodes_links.Attributes,
    Thickness=1)
panel_14 = Panel(expression_3)  # disabled
